% Simulink data dictionary controllerParams.sldd

guidanceParams = Simulink.Parameter(struct(phiCmd_rad=0, thetaCmd_rad=1.470796, psiCmd_rad=0.1))

innerLoopParams = Simulink.Parameter(struct(
  upRateLimitPitchYaw_dps=180,
  loRateLimitPitchYaw_dps=-180,
  upLimitPitchYaw_deg=45,
  loLimitPitchYaw_deg=-45,
  upRateLimitRoll_dps=90,
  loRateLimitRoll_dps=-90,
  upLimitRoll_deg=5,
  loLimitRoll_deg=-5,
  fbkGainBreakpoints_Pa=[0 5000 100000],
  fbkGainPitchYawP_na=[960 480 320],
  fbkGainPitchYawI_na=[18000 9000 6000],
  fbkGainPitchYawD_na=[0 0 0],
  fbkGainPitchYawN_na=[10 10 10],
  fbkGainRollP_na=[8 4 2.4],
  fbkGainRollI_na=[4 2 1.2],
  fbkGainRollD_na=[0 0 0],
  fbkGainRollN_na=[1 1 1]))

outerLoopParams = Simulink.Parameter(struct(
  upRateLimitPitchYawRate_rps2=0.5,
  loRateLimitPitchYawRate_rps2=-0.5,
  upLimitPitchYawRate_rps=0.1,
  loLimitPitchYawRate_rps=-0.1,
  pitchYawGains=[6 0.5 0 100],
  upRateLimitRollRate_rps2=5,
  loRateLimitRollRate_rps2=-5,
  upLimitRollRate_rps=2,
  loLimitRollRate_rps=-2,
  rollGains=[4 3 0 100]))