% Simulink data dictionary plantParams.sldd

vehicleParams = Simulink.Parameter(struct(mass_kg=18, area_m2=0.018, cg_m=1.811786, inertia_kgm2=[0.053 0 0; 0 8.41 0; 0 0 8.41]))
icParams = Simulink.Parameter(struct(velBdy_mps=[300 10 0], eul_rad=[0 1.570796 0], rateBdy_rps=[0 0 0], posNed_m=[0 0 0]))
envParams = Simulink.Parameter(struct(gravityNed_mps2=[0 0 9.81]))
windParams = Simulink.Parameter(struct(type=0, constantNed_mps=[5; 0; 0]))

aeroParams = Simulink.Parameter(struct(
  machBreakpoints_na=[0.1 0.2 0.3 0.4 0.5 0.6 0.7 0.8 0.9 1],
  aoaBreakpoints_deg=[0 2 4],
  controlBreakpoints_deg=[-4 -2 0 2 4],
  CpBase_m=[0.2686055 0.2686055 0.2686055
   0.2686055 0.2686055 0.2686055
   0.2686055 0.2686055 0.2686055
   0.2686055 0.2686055 0.2686055
   0.2686055 0.2686055 0.2686055
   0.2686055 0.2686055 0.2686055
   0.2686055 0.2686055 0.2686055
   0.2686055 0.2686055 0.2686055
   0.2686055 0.2686055 0.2686055
   0.2736923 0.4835062 0.6028453],
  CaBase_na=[0.3005777 0.3009442 0.3020474
   0.3002139 0.30058 0.3016819
   0.299853 0.3002187 0.3013192
   0.2994951 0.2998603 0.3009595
   0.2991402 0.299505 0.300603
   0.2987885 0.2991529 0.3002495
   0.29844 0.2988039 0.2998993
   0.2980947 0.2984582 0.2995523
   0.2977527 0.2981158 0.2992086
   0.4147114 0.4152171 0.4167392],
  CnBase_na=[0 0.06981317 0.1396263
   0 0.06981317 0.1396263
   0 0.06981317 0.1396263
   0 0.06981317 0.1396263
   0 0.06981317 0.1396263
   0 0.06981317 0.1396263
   0 0.06981317 0.1396263
   0 0.06981317 0.1396263
   0 0.06981317 0.1396263
   0 0.08803179 0.2114643],
  CnFin_na=reshape([-0.09006496 -0.09006496 -0.09006496 -0.09006496 -0.09006496 -0.09006496 -0.09006496 -0.09006496 -0.09006496 -0.0699544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], 10, 3, 5),
  CaFin_na=reshape([0.08032066 0.08048988 0.08126684 0.08268985 0.08439015 0.08651262 0.09092299 0.09251526 0.1020517 0.1066669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], 10, 3, 5),
  finCP1_m=[2.667005; 0.1270003; 0],
  finCP2_m=[2.667005; 0; 0.1270003],
  finCP3_m=[2.667005; -0.1270003; 0],
  finCP4_m=[2.667005; 0; -0.1270003],
  finAngles1_rad=[0 0 0],
  finAngles2_rad=[1.570796 0 0],
  finAngles3_rad=[3.141593 0 0],
  finAngles4_rad=[4.712389 0 0]))